# Grasshopper definition Sample2.ghx (Grasshopper 1.0.7)

push_to_bake = Button()
brep = Brep([<brep referenced from the Rhino model> x6])
taskdialog = CSharpScript(
    Caption="Grasshopper",
    Message="Hello Revit!!",
    Reference=["C:\Program Files\Autodesk\Revit 2019\RevitAPI.dll", "C:\Program Files\Autodesk\Revit 2019\RevitAPIUI.dll"])  # -> out, Result; inputs Caption: String, Message: String; disabled
# ---------- taskdialog: C# ----------
    Result = Autodesk.Revit.UI.TaskDialog.Show(Caption, Message);
# ---------- end taskdialog ----------
revit_bake = CSharpScript(
    Brep=brep,
    Bake=push_to_bake,
    Reference=["C:\Users\kike.garbo\AppData\Roaming\Autodesk\Revit\Addins\2019\RhinoInside.Revit\RhinoInside.Revit.dll", "C:\Program Files\Autodesk\Revit 2019\RevitAPIUI.dll", "C:\Program Files\Autodesk\Revit 2019\RevitAPI.dll"])  # -> out; inputs Brep: list of Brep, Bake: Boolean
# ---------- revit_bake: C# ----------
    if(Bake)
      RhinoInside.Revit.BakeGeometry(Brep);
# ---------- end revit_bake ----------
panel = Panel(taskdialog.Result)
panel_2 = Panel(revit_bake)
